# Grasshopper definition trail_line.gh (Grasshopper 1.0.7)

elements_spacing_mm = Slider(4.42, range=0..100)
bed_dimensions_mm = Slider(220, range=0..1000)
element_width = Slider(50, range=0..110)

rectangle = Rectangle(Plane=PlaneXY(0, 0, 0), XSize=bed_dimensions_mm, YSize=bed_dimensions_mm, Radius=0)  # -> Rectangle, Length
debrep = DeconstructBrep(Brep=rectangle.Rectangle)  # -> Faces, Edges, Vertices
midpt = CurveMiddle(Curve=debrep.Edges)
item = ListItem(List=midpt, Index=0, Wrap=True)  # -> Item, Item1, Item2, Item3
horizontal = Line(StartPoint=item.Item3, EndPoint=item.Item1)
division = Division(A=bed_dimensions_mm, B=elements_spacing_mm)
panel = Panel("""-1
1""")
round = Round(Number=division)  # -> Nearest, Floor, Ceiling
divide = DivideCurve(Curve=horizontal, Count=round.Nearest, Kinks=False)  # -> Points, Tangents, Parameters
addition = Addition(A=round.Nearest, B="1")
repeat = RepeatData(Data=panel, Length=addition)
multiplication = Multiplication(A=repeat, B=element_width)
Y = UnitY(Factor=multiplication)
move = Move(Geometry=divide.Points, Motion=Y)  # -> Geometry, Transform
merge = Merge(Data1=graft(divide.Points), Data2=graft(move.Geometry), Data3=graft(divide.Points))  # -> flatten(Result)
shift = ShiftList(List=merge, Shift=1, Wrap=True)
vec2pt = Vector2Pt(PointA=merge, PointB=shift, Unitize=False)  # -> Vector, Length
unit = UnitVector(Vector=vec2pt.Vector)
lng = ListLength(List=vec2pt.Vector)
amp = Amplitude(Vector=unit, Amplitude=Slider(10, range=0..10))
series = Series(Start=0, Step=1, Count=lng)
addition_2 = Addition(A=merge, B=amp)
vdisex = VectorDisplayEx(Point=merge, Vector=amp, Colour=ColourSwatch(SwatchColor=RGB(41, 65, 204)), Width=Slider(4, range=0..5))
tag = TextTag(Location=addition_2, Text=series, Colour=ColourSwatch(SwatchColor=RGB(255, 255, 255)))
pline = PolyLine(Vertices=merge, Closed=False)
